# Grasshopper definition analysis.gh (Grasshopper 1.0.7)
# plug-ins: Geospatial, Human, Excel

number_slider = Slider(29, range=0..29)
panel = Panel("D:\Code\114_temp\008_CodeCollection\005_java\matsim_preparation\src\main\resources\output_ucl\002\r_global\output_img\output_events_{0}.xlsx")
file_path = FilePath("D:\Code\114_temp\008_CodeCollection\005_java\matsim_preparation\src\main\resources\debug\part_london\buildings.geojson")

file_path_2 = FilePath("D:\Code\114_temp\008_CodeCollection\001_python\009_ResilienceCalculation\data\hereMap\geojson\boundary.geojson")
read_geojson = ReadGeoJSON(File=file_path_2)  # -> Type, Geometry, Keys, Values
custom_preview_lineweights = CustomPreviewLineweights(
    Geometry=read_geojson.Geometry,
    Shader={diffuse=RGB(255, 105, 180), emission=RGB(76, 32, 54), shine=0.5, specular=RGB(255, 255, 255), transparency=0},
    Thickness=Slider(4, range=0..10),
    Absolute=False)

panel_2 = Panel("D:\Code\114_temp\008_CodeCollection\005_java\matsim_preparation\src\main\resources\output_ucl\002\r_global\output_img\output_events_{0}.xlsx")
file_path_3 = FilePath("D:\Code\114_temp\008_CodeCollection\005_java\matsim_preparation\src\main\resources\output_ucl\002\r_global\output_img\link_counts.xlsx")
format = Format(Format=panel_2, Culture=127, Data0=Slider(29, range=0..29))
panel_3 = Panel(format)
excelread = ExcelRead(Start=Toggle(True), FilePath=file_path_3)
cull_index = CullIndex(List=excelread, Indices=0, Wrap=True)
flip_matrix = FlipMatrix(Data=cull_index)
list_item = ListItem(List=flip_matrix, Index="10", Wrap=True)  # -> Item, flatten(Item1)
c_script = CSharpScript(x=list_item.Item)  # -> A; inputs x: tree of String
# ---------- c_script: C# usings ----------
using System.Text.RegularExpressions;
# ---------- c_script: C# ----------
    int count = x.BranchCount;
    DataTree<string> res = new DataTree<string>();
    var debug = new List<string>();
    for (int i = 0; i < count; i++)
    {
      var branch = x.Branches[i];
      var temp = branch[0];
      string[] spl = temp.Split(new char[] {' ', '(', ')',','}, StringSplitOptions.RemoveEmptyEntries);
      //var spl = Match(temp);
      //debug.Add(parts[1]);
      GH_Path path = new GH_Path(i);
      //res.Add(spl[0], path);
      res.Add(spl[1], path);
      res.Add(spl[2], path);
      res.Add(spl[3], path);
      res.Add(spl[4], path);
    }
    A = res;
# ---------- c_script: C# additional code ----------
  private string[] Match(string input){
    string[] parts = input.Split(new char[] {' ', '(', ')'}, StringSplitOptions.RemoveEmptyEntries);
    return parts;
  }
# ---------- end c_script ----------
list_item_2 = ListItem(List=c_script, Index=0, Wrap=True)  # -> Item, Item1, Item2, Item3
construct_point = ConstructPoint(XCoordinate=list_item_2.Item, YCoordinate=list_item_2.Item1, ZCoordinate=0)
construct_point_2 = ConstructPoint(XCoordinate=list_item_2.Item2, YCoordinate=list_item_2.Item3, ZCoordinate=0)
line = Line(StartPoint=construct_point, EndPoint=construct_point_2)  # -> flatten(Line)
custom_preview_lineweights_2 = CustomPreviewLineweights(Geometry=line, Shader=ColourSwatch(SwatchColor=RGB(143, 143, 143)), Thickness=Slider(1, range=0..10), Absolute=False)

file_path_4 = FilePath("D:\Code\114_temp\008_CodeCollection\005_java\matsim_preparation\src\main\resources\output_ucl\002\r_global\output_img\link_counts_32400-36000.xlsx")
read_geojson_2 = ReadGeoJSON(File=file_path)  # -> Type, Geometry, Keys, Values
list_item_3 = ListItem(List=read_geojson_2.Values, Index="5", Wrap=True)
list_item_4 = ListItem(List=read_geojson_2.Values, Index="4", Wrap=True)
format_2 = Format(Format=panel, Culture=127, Data0=number_slider)
panel_4 = Panel(format_2)
excelread_2 = ExcelRead(Start=Toggle(True), FilePath=format_2)
data = Data(flatten(read_geojson_2.Geometry))
c_script_2 = CSharpScript(geo=read_geojson_2.Geometry, use=list_item_3, height=list_item_4)  # -> A, B, C; inputs geo: tree of Curve, use: tree of String, height: tree of Double
# ---------- c_script_2: C# ----------
    DataTree<Curve> res_crv = new DataTree<Curve>();
    DataTree<string> res_use = new DataTree<string>();
    DataTree<double> res_height = new DataTree<double>();
    for (int i = 0; i < use.BranchCount; i++)
    {
      res_crv.Add(geo.Branches[i][0]);
      res_use.Add(Filter(use.Branches[i][0]));
      res_height.Add(height.Branches[i][0]);
    }
    A = res_crv;
    B = res_use;
    C = res_height;
# ---------- c_script_2: C# additional code ----------
  private string Filter(string str){
    string res = "";
    switch (str)
    {
      case "RETAIL ONLY":
      case "RETAIL WITH OFFICE/RESIDENTIAL ABOVE":
      case "RETAIL - VACANT/DERELICT":
      case "GENERAL COMMERCIAL - MIXED USE":
      case "RECREATION AND LEISURE":
      case "GENERAL COMMERCIAL - MIXED USE - DERELICT":
      case "RETAIL - PETROL STATION":
      case "RETAIL - WITH MORE RECENT EXTENSIONS OF DIFFERENT TYPE CONSTRUCTION/AGE":
        res = "C";
        break;
      case "RESIDENTIAL ONLY":
      case "RESIDENTIAL WITH RETAIL ON GROUND FLOOR":
        res = "R";
        break;
      case "COMMUNITY - INSTITUTIONAL AND COMMUNAL ACCOMMODATION":
        res = "H";
        break;
      case "OFFICE ONLY":
      case "TRANSPORT":
      case "COMMUNITY - HEALTH":
      case "OFFICE WITH RETAIL ON GROUND FLOOR":
      case "COMMUNITY - GOVERNMENTAL (CENTRAL AND LOCAL)":
      case "COMMUNITY - RELIGIOUS":
      case "COMMUNITY - EDUCATIONAL":
      case "COMMUNITY - EMERGENCY SERVICES":
      case "AGRICULTURAL - UNCLASSIFIED":
      case "UNCLASSIFIED":
        res = "O";
        break;
      case "INDUSTRY - MANUFACTURING/PROCESSING":
        res = "M";
        break;
      case "UTILITIES":
        res = "W";
        break;
    }

    return res;
  }
# ---------- end c_script_2 ----------
area = Area(Geometry=c_script_2.A)  # -> Area, Centroid
panel_5 = Panel("""function
totalArea
floors""")
list_length = ListLength(List=c_script_2.A)
ghpython_script = GhPythonScript(x=c_script_2.C)  # -> a; inputs x: list
# ---------- ghpython_script: Python ----------
import math
res=[]
for i in range(len(x)):
    floor=-1
    if x[i] ==0:
        floor=1
    else:
        floor=math.ceil(x[i]/3.0)
    res.append(floor)
a=res
# ---------- end ghpython_script ----------
cull_index_2 = CullIndex(List=excelread_2, Indices=0, Wrap=True)
flip_matrix_2 = FlipMatrix(Data=cull_index_2)
series = Series(Start=0, Step=1, Count=list_length)
multiplication = Multiplication(A=area.Area, B=ghpython_script)
list_item_5 = ListItem(List=flip_matrix_2, Index="10", Wrap=True)  # -> Item, flatten(Item1)
c_script_3 = CSharpScript(x=list_item_5.Item)  # -> A; inputs x: tree of String; same code as c_script
format_3 = Format(Format="output_events_{0}.geojson", Culture=127, Data0=number_slider)
merge = Merge(Data1=graft(c_script_2.B), Data2=graft(multiplication), Data3=graft(ghpython_script))  # -> simplify(Result)
cross_reference = CrossReference(ListListA=graft(series), ListListB=panel_5, CrossMode=1)  # -> simplify(ListListA), simplify(ListListB)
list_item_6 = ListItem(List=c_script_3, Index=0, Wrap=True)  # -> Item, Item1, Item2, Item3
curve = Curve([<curve referenced from the Rhino model> x438])
construct_domain = ConstructDomain(DomainStart="0.001", DomainEnd="1")
bounds = Bounds(Numbers=list_item_5.Item1)
construct_point_3 = ConstructPoint(XCoordinate=list_item_6.Item, YCoordinate=list_item_6.Item1, ZCoordinate=0)
construct_point_4 = ConstructPoint(XCoordinate=list_item_6.Item2, YCoordinate=list_item_6.Item3, ZCoordinate=0)
object_attributes = ObjectAttributes(ObjectOrAttributes=curve)  # -> Name, LayerName, LayerFullPath, Color, MaterialName, LinetypeName, GroupIndices, PlotWeight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
feature_from_polygons = FeatureFromPolygons(Polygons=graft(c_script_2.A), Keys=cross_reference.ListListB, Values=merge)
line_2 = Line(StartPoint=construct_point_3, EndPoint=construct_point_4)  # -> flatten(Line)
remap_numbers = RemapNumbers(Value=list_item_5.Item1, Source=bounds, Target=construct_domain)  # -> Mapped, Clipped
list_length_2 = ListLength(List=remap_numbers.Mapped)
duplicate_data = DuplicateData(Data="count", Number=list_length_2, Order=True)
subtraction = Subtraction()
panel_6 = Panel("D:\Code\114_temp\008_CodeCollection\001_python\009_ResilienceCalculation\data\hereMap\matsim_count")
gradient = Gradient(
    LowerLimit=0,
    UpperLimit=1,
    Parameter=remap_numbers.Mapped,
    stops=[0: RGB(0, 128, 0), 0.155: RGB(255, 255, 0), 0.606: RGB(255, 0, 0)])
join_geojson = JoinGeoJSON(Features=flatten(feature_from_polygons))
panel_7 = Panel("D:\Code\114_temp\008_CodeCollection\005_java\matsim_preparation\src\main\resources\debug\part_london")
list_item_7 = ListItem(List=object_attributes.UserDataValues, Index=Slider(7, range=0..10), Wrap=True)
list_item_8 = ListItem(List=object_attributes.UserDataValues, Index=Slider(4, range=0..10), Wrap=True)
feature_from_lines = FeatureFromLines(Curves=graft(line_2), Keys=graft(duplicate_data), Values=graft(remap_numbers.Mapped))
boolean_toggle = BooleanToggle(False)
number = Number(list_item_8)
custom_preview_lineweights_3 = CustomPreviewLineweights(Geometry=line_2, Shader=gradient, Thickness=Slider(5, range=0..10), Absolute=False)
number_2 = Number(list_item_7)
ghpython_script_2 = GhPythonScript(x=flatten(number_2), y=flatten(number))  # -> out, a; inputs x: list, y: list
# ---------- ghpython_script_2: Python ----------
mean_x = sum(x) / float(len(x))
mean_y = sum(y) / float(len(y))

std_x = (sum([(i - mean_x) ** 2 for i in x]) / float(len(x) - 1)) ** 0.5
std_y = (sum([(i - mean_y) ** 2 for i in y]) / float(len(y) - 1)) ** 0.5

cov = sum([(x[i] - mean_x) * (y[i] - mean_y) for i in range(len(x))]) / float(len(x) - 1)

corr = cov / (std_x * std_y)

print(corr)
# ---------- end ghpython_script_2 ----------
write_file = WriteFile(Directory=panel_7, Filename="building.geojson", Data=join_geojson, Run=boolean_toggle, Overwrite=boolean_toggle)
boolean_toggle_2 = BooleanToggle(False)
join_geojson_2 = JoinGeoJSON(Features=flatten(feature_from_lines))
data_2 = Data()
panel_8 = Panel(ghpython_script_2.out)
list_item_9 = ListItem(List=remap_numbers.Mapped, Index=data_2, Wrap=False)
clean_tree = CleanTree(RemoveNulls=True, RemoveInvalid=True, RemoveEmpty=False, Tree=list_item_9)
construct_domain_2 = ConstructDomain(DomainStart="0.001", DomainEnd="1")

panel_9 = Panel("D:\Code\114_temp\008_CodeCollection\001_python\009_ResilienceCalculation\data\hereMap\intersect")
number_slider_2 = Slider(42, range=12..42)
point = Point(<point referenced from the Rhino model>)
ghpython_script_3 = GhPythonScript(x=panel_9)  # -> a, b
# ---------- ghpython_script_3: Python ----------
import os

res=[]
res_file=[]
for filename in os.listdir(x):
    res.append(os.path.join(x,filename))
    res_file.append(os.path.split(filename)[-1])
    
a=res
b=res_file
# ---------- end ghpython_script_3 ----------
list_item_10 = ListItem(List=ghpython_script_3.a, Index=number_slider_2, Wrap=True)
list_item_11 = ListItem(List=ghpython_script_3.b, Index=number_slider_2, Wrap=True)
file_path_5 = FilePath(list_item_10)
read_geojson_3 = ReadGeoJSON(File=file_path_5)  # -> Type, Geometry, Keys, Values
text_tag_3d = TextTag3D(Location=point, Text=list_item_11, Size=Slider(254, range=0..10000), Justification=7)
explode_tree = ExplodeTree(Data=read_geojson_3.Keys)
panel_10 = Panel(explode_tree)
list_item_12 = ListItem(List=read_geojson_3.Values, Index=Slider(7, range=0..10), Wrap=True)
data_3 = Data(flatten(list_item_12))
list_length_3 = ListLength(List=data_3)
series_2 = Series(Start=0, Step=1, Count=list_length_3)
equality = Equality(FirstNumber=data_3, SecondNumber="-1")  # -> Equality, Inequality
dispatch = Dispatch(List=series_2, DispatchPattern=equality.Inequality)  # -> ListA, ListB
panel_11 = Panel(subtraction)
data_4 = Data(flatten(read_geojson_3.Geometry))
list_item_13 = ListItem(List=data_4, Index=dispatch.ListA, Wrap=True)
list_item_14 = ListItem(List=data_3, Index=dispatch.ListA, Wrap=True)
construct_domain_3 = ConstructDomain(DomainStart="0", DomainEnd="9")
remap_numbers_2 = RemapNumbers(Value=list_item_14, Source=construct_domain_3, Target=construct_domain_2)  # -> Mapped, Clipped
gradient_2 = Gradient(
    LowerLimit=0,
    UpperLimit=1,
    Parameter=remap_numbers_2.Mapped,
    stops=[0: RGB(0, 128, 0), 0.0386: RGB(255, 255, 0), 0.436: RGB(255, 0, 0)])
graph_mapper = GraphMapper(
    remap_numbers_2.Mapped,
    x0=0,
    x1=1,
    y0=0,
    y1=1,
    container_name="Bezier",
    cpx=[0, 0.3000001907, 1, 1],
    cpy=[0, 0.4420289993, 0.610144794, 1])
custom_preview_lineweights_4 = CustomPreviewLineweights(Geometry=list_item_13, Shader=gradient_2, Thickness=Slider(4, range=0..10), Absolute=False)

createattributes = CreateAttributes(UserDataKeys=read_geojson_3.Keys, UserDataValues=read_geojson_3.Values, enableFullPath=False)
list_item_15 = ListItem(List=read_geojson_3.Values, Index=Slider(4, range=0..10), Wrap=True)
bake_geometry = BakeGeometry(
    Bake=Toggle(False),
    Geometry=simplify(flatten(read_geojson_3.Geometry)),
    Attributes=simplify(flatten(createattributes)),
    DeleteOldBakes=False,
    PreserveTrees=False)
ghpython_script_4 = GhPythonScript(x=flatten(list_item_12), y=flatten(list_item_15))  # -> out, a; inputs x: list, y: list; same code as ghpython_script_2
panel_12 = Panel(ghpython_script_4.out)
write_file_2 = WriteFile(Directory=panel_6, Filename=format_3, Data=join_geojson_2, Run=boolean_toggle_2, Overwrite=boolean_toggle_2)
panel_13 = Panel(clean_tree)
panel_14 = Panel(remap_numbers_2.Mapped)
