# Grasshopper definition removeRoad.gh (Grasshopper 1.0.7)
# plug-ins: Geospatial, UrbanXTools

number_slider = Slider(500, range=0..1000)
number_slider_2 = Slider(500, range=0..1000)
file_path = FilePath("D:\Code\114_temp\008_CodeCollection\005_java\matsim_preparation\src\main\resources\debug\tq38_london\r_500\roadnetwork.geojson")
number_slider_3 = Slider(3000, range=0..10000)
number_slider_4 = Slider(2000, range=0..10000)
read_geojson = ReadGeoJSON(File=file_path)  # -> Type, flatten(Geometry), Keys, Values
panel = Panel(file_path)
panel_2 = Panel("-1")
panel_3 = Panel("D:\Code\114_temp\008_CodeCollection\005_java\matsim_preparation\src\main\resources\debug\tq38_london\r_{0}")
ns_computing3d = NS_Computing3D(RoadsData=read_geojson.Geometry, Radius=number_slider_4, Merge=True)  # -> MetricChoice, MetricIntegration, MetricMeanDepth, MetricTotalDepth, AngularChoice, AngularIntegration, AngularMeanDepth, AngularTotalDepth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; disabled
sort_list = SortList(Keys=ns_computing3d.MetricChoice, ValuesValuesA=ns_computing3d.CleanedRoadsData)  # -> Keys, ValuesValuesA
list_item = ListItem(List=sort_list.ValuesValuesA, Index=0, Wrap=True)
end_points = EndPoints(Curve=list_item)  # -> Start, End
feature_from_lines = FeatureFromLines(Curves=graft(sort_list.ValuesValuesA))
format = Format(Format=panel_3, Culture=127, Data0=number_slider_4)
panel_4 = Panel([end_points.Start, end_points.End])
join_geojson = JoinGeoJSON(Features=flatten(feature_from_lines))
button = Button()
write_file = WriteFile(Directory=format, Filename="roadnetwork.geojson", Data=join_geojson, Run=button, Overwrite=button)
